# Grasshopper definition GraphIsBipartite.gh (Grasshopper 1.0.7)
# Copyright: Liljewall Arkitekter
# plug-ins: Moth

# ---- group: Graph from lines
crv = Curve([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])
graphlines = GraphFromLines(Lines=crv)  # -> Graph, Points
pt = Point(graphlines.Points)
data = Data(graphlines.Graph)

# ---- group: IsGraphBipartite
gbipartite = IsGraphBipartite(Graph=data, ListOfPoints=pt)  # -> Result, IndicesSets, SetA, SetB
pt_2 = Point(gbipartite.SetB)
panel = Panel(gbipartite.Result)
panel_2 = Panel(gbipartite.IndicesSets)
pt_3 = Point(gbipartite.SetA)
