# Grasshopper definition GraphMinimumSpanningTree.gh (Grasshopper 1.0.7)
# Copyright: Liljewall Arkitekter
# plug-ins: Moth

# ---- group: Graph from lines
crv = Curve([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])
graphlines = GraphFromLines(Lines=crv)  # -> Graph, Points
pt = Point(graphlines.Points)
data = Data(graphlines.Graph)

# ---- group: Minimun Spanning Tree
mst = MinimunSpanningTree(Graph=data, ListOfPoints=pt)
geo = Geometry(mst)
