# Grasshopper definition MeshKNearest.gh (Grasshopper 1.0.7)
# Copyright: Liljewall Arkitekter
# plug-ins: Moth

# ---- group: Mesh K Nearest ++
number_slider = Slider(4, range=0..100)
mesh = Mesh(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)
mfaceclustering = MeshFaceClusteringWithKMeans(Mesh=mesh, NClusters=number_slider)  # -> FaceClusters, ClustersOfIndices
demesh = DeconstructMesh(Mesh=mesh)  # -> Vertices, Faces, Colours, Normals
range = Range(Domain=Domain(0, 1), Steps=number_slider)
gradient = Gradient(
    LowerLimit=0,
    UpperLimit=1,
    Parameter=range,
    stops=[0: RGB(255, 0, 0), 0: RGB(97, 34, 73), 0.1: RGB(236, 27, 60), 0.2: RGB(210, 0, 118), 0.3: RGB(103, 0, 120), 0.4: RGB(39, 72, 161), 0.5: RGB(1, 192, 229), 0.6: RGB(18, 178, 90), 0.7: RGB(79, 186, 8), 0.8: RGB(220, 237, 32), 0.9: RGB(247, 159, 20), 1: RGB(243, 57, 0)])
deface = DeconstructFace(Face=mfaceclustering.FaceClusters)  # -> CornerA, CornerB, CornerC, CornerD
merge = Merge(Data1=graft(deface.CornerA), Data2=graft(deface.CornerB), Data3=graft(deface.CornerC))  # -> simplify(Result)
cull_i = CullIndex(List=gradient, Indices=0, Wrap=True)
item = ListItem(List=demesh.Vertices, Index=merge, Wrap=True)
jitter = Jitter(List=cull_i, Jitter=1, Seed=28763)  # -> graft(Values), Indices
pline = PolyLine(Vertices=item, Closed=True)
boundary = BoundarySurfaces(Edges=pline)
trim = TrimTree(Tree=boundary, Depth=1)
preview = CustomPreview(Geometry=trim, Material=jitter.Values)
