# Grasshopper definition MeshReduction.gh (Grasshopper 1.0.7)
# Copyright: Liljewall Arkitekter
# plug-ins: Moth

# ---- group: Mesh Reduction
mesh = Mesh(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)
mrangle = MeshReductionByAngle(Mesh=mesh, Angle=Slider(0.089, range=0..1))  # -> ReducedVertices, ReducedMesh
mesh_2 = Mesh(mrangle.ReducedMesh)
pt = Point(mrangle.ReducedVertices)
del = DelaunayMesh(Points=pt, Plane=PlaneXY(0, 0, 0))
medges = MeshEdges(Mesh=del)  # -> NakedEdges, InteriorEdges, NonManifoldEdges
