# Grasshopper definition GraphCentralities.gh (Grasshopper 1.0.7)
# Copyright: Liljewall Arkitekter
# plug-ins: Moth

# ---- group: Graph from lines
crv = Curve([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])
graphlines = GraphFromLines(Lines=crv)  # -> Graph, Points
pt = Point(graphlines.Points)
data = Data(graphlines.Graph)

# ---- group: Closeness Centrality
ccentrality = ClosenessCentrality(Graph=data, ListOfPoints=pt, Weighted=Toggle(False))  # -> Centrality, NormalizedCentrality
panel = Panel(ccentrality.Centrality)
panel_2 = Panel(ccentrality.NormalizedCentrality)

# ---- group: Betweeness Centrality
bcentrality = BetweenessCentrality(Graph=data, ListOfPoints=pt)  # -> Centrality, NormalizedCentrality
panel_3 = Panel(bcentrality.Centrality)
panel_4 = Panel(bcentrality.NormalizedCentrality)
