# Grasshopper definition GraphShortestPath.gh (Grasshopper 1.0.7)
# Copyright: Liljewall Arkitekter
# plug-ins: Moth

# ---- group: Graph from lines
crv = Curve([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])
graphlines = GraphFromLines(Lines=crv)  # -> Graph, Points
pt = Point(graphlines.Points)
data = Data(graphlines.Graph)

# ----
pt_2 = Point(pt)
data_2 = Data(data)

# ---- group: Shortest path
spath = ShortestPath(Graph=data_2, IndexOfStartingPoint="2", IndexOfEndingPoint="3")
panel = Panel(spath)

# ----
item = ListItem(List=pt_2, Index=panel, Wrap=True)
pline = PolyLine(Vertices=item, Closed=False)
