# Grasshopper definition Grids.gh (Grasshopper 1.0.7)
# Copyright: Liljewall Arkitekter
# plug-ins: Moth

# ---- group: sorted grid
xy = XYPlane(Origin=Point(0, 0, 0))
geo = Geometry(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)
cplanargrid = CurvePlanarGridComponent(Curve=geo, CellSize=Slider(21.45, range=0..100), Plane=xy)

# ---- group: Grid A
geo_2 = Geometry(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)
psubdivision = PlotSubdivisionComponent(Curve=geo_2, MinimumLength=Slider(4, range=0..100), Iterations=Slider(5, range=0..10), Seed=Slider(135, range=0..1000))

# ---- group: Grid B
geo_3 = Geometry(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)
psubdivisionangle = PlotSubdivisionAngleComponent(Curve=geo_3, MinimumLength=Slider(15, range=0..100), Iterations=Slider(5, range=0..10), Seed=Slider(465, range=0..1000))

# ----
geo_4 = Geometry(cplanargrid)

# ---- group: cell partitioning
geo_5 = Geometry(geo_4)
rcellpart = RecursiveCellPartitioning(SortedGrid=geo_5, MaxSize=Slider(3, range=0..10), Seed=Slider(450, range=0..1000))

# ---- group: maze
geo_6 = Geometry(geo_4)
maze = Maze(SortedGrid=geo_6, Seed=Slider(12, range=0..100))  # -> Maze, Paths
